# Grasshopper definition Castro_SeaLevelX13.gh (Grasshopper 1.0.7)
# plug-ins: Human UI

lossy = Slider(13, range=0..50)
# WAVE GENERATOR
panel = Panel("3")
curve = Curve(<curve referenced from the Rhino model>)
curve_2 = Curve(<curve referenced from the Rhino model>)
pulse_import = PulseImport(toggle=Toggle(False), port=Slider(3, range=0..5))  # -> ui_pulse_detected_2, pulse_value_2
sea_level_x_color = SeaLevelXColor(size=panel, outline=curve, coastline=curve_2, lossy=lossy)  # -> chunks, decontructed_mesh, colour
pulse_sim = Slider(40, range=40..150)
trigger = Trigger(Interval=1000, TimerInterval=1000, Target=heart_rate_list)  # disabled
number_slider = Slider(0.347, range=0..2)
list_item = ListItem(List=sea_level_x_color.chunks, Index="1", Wrap=True)
list_item_2 = ListItem(List=sea_level_x_color.chunks, Index="2", Wrap=True)
list_item_3 = ListItem(List=sea_level_x_color.chunks, Index="3", Wrap=True)
boolean_toggle = BooleanToggle(False)
heart_rate_list = GhPythonScript(reset=Toggle(False), pulse=pulse_sim)  # -> heart_rate
# ---------- heart_rate_list: Python ----------
__author__ = "ericsonm"
__version__ = "2023.04.17"

import rhinoscriptsyntax as rs
import scriptcontext as sc

# Add empty list to sticky / clear list

value = int(pulse)
if "value" not in sc.sticky or reset:
    sc.sticky["value"] = []
if not reset:
    sc.sticky["value"].append(pulse)
    if len(sc.sticky["value"]) > 2:
        sc.sticky["value"].pop(0)
    heart_rate = sc.sticky["value"]
# ---------- end heart_rate_list ----------
sea_level_x_pulse = SeaLevelXPulse(reset=boolean_toggle, scale_factor=number_slider, pulse_live=heart_rate_list)  # -> count_2, current_pulse_3
sea_level_x_pulse_inv = SeaLevelXPulseInv(reset=boolean_toggle, scale_factor=number_slider, pulse_live=heart_rate_list)  # -> count_2, current_pulse_3
negative = Negative(Value=sea_level_x_pulse_inv.count_2)
negative_2 = Negative(Value=sea_level_x_pulse.count_2)
panel_2 = Panel(negative_2)
box_rectangle = BoxRectangle(Rectangle=list_item, Height=negative)
box_rectangle_2 = BoxRectangle(Rectangle=[list_item_2, list_item_3], Height=negative_2)
round = Round(Number=sea_level_x_pulse_inv.current_pulse_3)  # -> Nearest, Floor, Ceiling
custom_preview = CustomPreview(Geometry=[box_rectangle, box_rectangle_2], Material=sea_level_x_color.colour)

ui_model_picker = UIModelPicker()  # -> ui_model_picker_2, _3dm_2
sea_level_x_year = SeaLevelXYear(csv="D:\ARCH 441\Spring 2023\Sea Levelsx.csv")  # -> years_2, sea_level_2
ui_create_viewport = UICreateViewport(toggle=Toggle(False))
ui_zoom_viewport = UIZoomViewport(model=ui_model_picker._3dm_2)

# ----
# the data is a LIST and can be read using its index #s
panel_3 = Panel(sea_level_x_year.years_2)
list_item_4 = ListItem(List=panel_3, Index="20", Wrap=True)
panel_4 = Panel(list_item_4)

timeline = GhPythonScript()  # -> current_year
# ---------- timeline: Python ----------
#kayla castro
#04/18/23
#this component iterates through a list to get the year

#year is preserved

import rhinoscriptsyntax as rs
import scriptcontext


def get_next_or_prev_item(year, counter):
    try:
        index = year.index(counter)
        if counter > 5:
            # return the next item in the list
            if index == len(year) - 1:
                # if the variable is the last item in the list, return the first item
                return year[0]
            else:
                return year[index + 1]
        else:
            # return the previous item in the list
            if index == 0:
                # if the variable is the first item in the list, return the last item
                return year[-1]
            else:
                return year[index - 1]
    except ValueError:
        print("{} is not a valid index.".format(counter))


current_year = get_next_or_prev_item(year, counter)
print(current_year)
# ---------- end timeline ----------
ghpython_script = GhPythonScript(year=panel_3, counter="3")  # -> current_year; inputs year: list
# ---------- ghpython_script: Python ----------
#kayla castro
#04/18/23
#this component iterates through a list to get the year

#test to get the code to run 

import rhinoscriptsyntax as rs

def get_next_or_prev_item(year, counter):
    if counter > 5:
        # return the next item in the list
        index = year.index(counter)
        if index == len(year) - 1:
            # if the variable is the last item in the list, return the first item
            return year[0]
        else:
            return year[index + 1]
    else:
        # return the previous item in the list
        index = year.index(counter)
        if index == 0:
            # if the variable is the first item in the list, return the last item
            return year[-1]
        else:
            return year[index - 1]

current_year = get_next_or_prev_item (year, counter)
# ---------- end ghpython_script ----------
timeline_2 = GhPythonScript(counter="3")  # -> current_year
# ---------- timeline_2: Python ----------
#kayla castro
#04/18/23
#this component iterates through a list to get the year

#years are listed out in an attempt to get the code to run

import rhinoscriptsyntax as rs
import scriptcontext

year = [2023, 2024, 2025, 2026, 2027,
2028,
2029,
2030,
2031,
2032,
2033,
2034,
2035,
2036,
2037,
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
def get_next_item(year, counter):
    try:
        index = year.index(counter)
        if index == len(year) - 1:
            return year[0]
        else:
            return year[index + 1]
    except ValueError:
        print("{} is not a valid index.".format(counter))

for i, value in enumerate(year):
    if i == counter:
        print(get_next_item(year, value))
        break
else:
    print("{} is not a valid index.".format(counter))
# ---------- end timeline_2 ----------
# YEAR COUNTER
panel_5 = Panel(timeline_2)

sea_level_count = GhPythonScript(counter="3")  # -> current_year; same code as timeline_2
sea_level_count_2 = GhPythonScript()  # -> current_year; same code as timeline
ghpython_script_2 = GhPythonScript(year=panel_3, counter="3")  # -> current_year; inputs year: list; same code as ghpython_script
# SEA LEVEL  COUNTER
panel_6 = Panel(sea_level_count)

create_range_slider = CreateRangeSlider(SliderRange=Slider(2023, range=2023..2159), StartingRange=sea_level_x_year.sea_level_2)
create_label = CreateLabel(LabelText="Year", LabelSize=12, Justification=0)
create_label_2 = CreateLabel(LabelText=sea_level_x_year.sea_level_2, LabelSize=12, Justification=0)
create_range_slider_2 = CreateRangeSlider(SliderRange=Slider(280, range=0..280), StartingRange=pulse_import.pulse_value_2)
current_year = GhPythonScript(years=sea_level_x_year.years_2)  # -> current_year; inputs years: list
# ---------- current_year: Python ----------
#kayla castro
#03/19/2023
#this component gives last pulse



current_year = years[-1]
# ---------- end current_year ----------
create_label_3 = CreateLabel(LabelText="Pulse", LabelSize=12, Justification=0)
panel_7 = Panel(current_year)
show = Text()
show_2 = Text(show)
number_slider_2 = Slider(720, range=0..1000)
launch_window = LaunchWindow(
    Show=Toggle(False),
    Name="SeaLevelX",
    Width=number_slider_2,
    Height=number_slider_2,
    ChildStatus=1,
    EnableHorizScroll=False)
create_label_4 = CreateLabel(LabelText="Welcome to SeaLevel X", LabelSize="30", Justification="1")
create_label_5 = CreateLabel(LabelText="Please choose a model to work with today:", LabelSize="15", Justification=0)
create_label_6 = CreateLabel(LabelText="RESET WAVE", LabelSize=12, Justification=0)
create_label_7 = CreateLabel(LabelText="START WAVE", LabelSize=12, Justification=0)
create_label_8 = CreateLabel(LabelText="DRAWING TOOLS:", LabelSize="15", Justification="1")
value_listener = ValueListener(SomeProperty=True)  # -> Values, Indices
number_slider_3 = Slider(720, range=0..1000)
add_elements = AddElements(
    Window=launch_window,
    Elements=flatten([create_label_4, pulse_import.ui_pulse_detected_2, create_label_3, create_range_slider_2, create_label, create_range_slider, create_label_8]),
    DoVLChecking=True)  # -> AddedElements, ElementNames
create_chart = CreateChart(Names="DATA REPORT", Title="DATA REPORT", ChartType=0)
create_label_9 = CreateLabel(LabelText="YOUR REPORT", LabelSize="30", Justification="1")
launch_window_2 = LaunchWindow(
    Show=Toggle(True),
    Name="SeaLevelX",
    Width=number_slider_3,
    Height=number_slider_3,
    ChildStatus=1,
    EnableHorizScroll=False)
panel_8 = Panel(add_elements.ElementNames)
add_elements_2 = AddElements(Window=launch_window_2, Elements=flatten([create_chart, create_label_9]), DoVLChecking=True)  # -> AddedElements, ElementNames

# ==== cluster UIModelPicker
panel = Panel("""Theme Building
Parc De La Villette""")
create_list_box = CreateListBox(ListItems=panel, SelectedIndex=0, Height=Slider(100, range=0..100))
value_listener = ValueListener(Elements=create_list_box, SomeProperty=True)  # -> Values, Indices
panel_2 = Panel(value_listener.Values)
# MODEL PICKER
model_picker = GhPythonScript(model_choice=panel_2)  # -> model_sel; inputs model_choice: list of Int32
# ---------- model_picker: Python ----------
#this component determines the correct filepath per the user's model selection
#kayla castro
#03/22/23

###### with help from chat gpt

###### main 

theme_building = r"D:\ARCH 441\Spring 2023\SeaLevelX\theme_building.3dm"
parc_dela_villette = r"D:\ARCH 441\Spring 2023\SeaLevelX\pac_dela_villette2.3dm"

def get_model_choice(model_choice):
    for i, val in enumerate(model_choice):
        if val:
            try:
                return {
                    1: theme_building
                    2: parc_dela_villette
                }[i+1]  # Add 1 to the index to match the keys in the dictionary
            except KeyError:
                print("Invalid model choice: {i+1}")
    print("No valid model choice selected.")
    return None

model_sel = get_model_choice(model_choice)
print("Selected model: {model_sel}")
# ---------- end model_picker ----------
panel_3 = Panel(model_picker)
import_3dm = Import3DM(File=panel_3, Layer="*", Name="*")  # -> flatten(Geometry)
ui_model_picker = Text(create_list_box)
_3dm = Brep(import_3dm)
ui_model_picker_2 = ClusterOutput(ui_model_picker)
_3dm_2 = ClusterOutput(_3dm)

# ==== cluster UICreateViewport
toggle = ClusterInput()
toggle_2 = Text(toggle)
create_toggle = CreateToggle(Default=toggle_2, Label="Viewports", OnLabel="Show", OffLabel="Hide")
ui_viewports = Text(create_toggle)
value_listener = ValueListener(Elements=create_toggle, SomeProperty=True)  # -> Values, Indices
panel = Panel(value_listener.Values)
create_viewport = GhPythonScript(
    create_viewport=value_listener.Values,
    width="600",
    height="600",
    view_name="Isometric",
    projection="Perspective",
    display_mode="Hidden")  # inputs create_viewport: Boolean, width: Int32, height: Int32
# ---------- create_viewport: Python ----------
from ghpythonlib.componentbase import executingcomponent as component
import Grasshopper, GhPython
import System
import Rhino
import rhinoscriptsyntax as rs
import scriptcontext as sc

class MyComponent(component):
    
    def RunScript(self, create_viewport, width, height, view_name, projection, display_mode):
        """Provides a  component to create and control viewport
            Inputs:
                create_viewport:  Boolean to create viewport
                width: Width of viewport
                height:  Height of viewport
                view_name: Name of new viewport
                display_mode: Sets the display mode
                "Rendered", "Wireframe", "Ghosted", "Shaded", "X-Ray", "Arctic", "Technical", "Artistic", "Pen"
                zoom_extents:  Boolean to zoom window extents
                
                """

        
        __author__ = "erics"
        __version__ = "2022.11.10"
        

        
        def zoom_scale(percentage):
            """
            Zooms the active window by a value
            example:
            zoom_scale(.75)
            """
            command = "Zoom Factor" + " " + str(float(percentage))
            rs.Command(command)

        def set_display_mode(view_name, display_mode="Rendered"):
            """
            Sets the disaplay mode of a specific viewport
            view_name: name of the view
            display_mode: Sets the mode of of display.  If None == "Rendered".  
            "Rendered", "Wireframe", "Ghosted", "Shaded", "X-Ray", "Arctic", "Technical", "Artistic", "Pen"
            example:
            set_display_mode("Top", display_mode="Wireframe")
                """
            rs.EnableRedraw(True)
            viewport = sc.doc.Views.Find(view_name, False).ActiveViewport
            mode = Rhino.Display.DisplayModeDescription.FindByName(display_mode)
            viewport.DisplayMode = mode
            return viewport
        
        def create_parallel_view(view_name, size, projection, display="Rendered"):
            """Creates a new viewport in top, parallel view.
            view_name:  name of view to be added
            size:  Tuple of X and Y dimensions in pixels of the viewport to be created (x_size, y_size)
            display_mode: Sets the mode of of display.  If None == "Rendered".  
            "Rendered", "Wireframe", "Ghosted", "Shaded", "X-Ray", "Arctic", "Technical", "Artistic", "Pen"
            example:
            create_parallel_view("Axo", (800,800), display_mode="Rendered")
            """
            size_x, size_y = size
            method = "Rhino.Display.DefinedViewportProjection." + str(projection)
            view =  eval(method)
            dimensions = System.Drawing.Rectangle(20,20,size_x,size_y)
            sc.doc = Rhino.RhinoDoc.ActiveDoc
            sc.doc.Views.Add(view_name, view, dimensions,True)
            viewport = set_display_mode(view_name, display)
            sc.doc = ghdoc
#main__________________________________________________________________________________________
        if create_viewport:
            if (width and height and display_mode and view_name and projection) != None: 
                viewport = create_parallel_view(view_name, (width, height), projection, display_mode)

        else:pass
# ---------- end create_viewport ----------
create_viewport_2 = GhPythonScript(
    create_viewport=value_listener.Values,
    width="600",
    height="600",
    view_name="Elevation",
    projection="Left",
    display_mode="Hidden")  # inputs create_viewport: Boolean, width: Int32, height: Int32; same code as create_viewport
create_viewport_3 = GhPythonScript(create_viewport=panel, width="600", height="600", view_name="Plan", projection="Top", display_mode="Hidden")  # inputs create_viewport: Boolean, width: Int32, height: Int32; same code as create_viewport
ui_viewports_2 = ClusterOutput(ui_viewports)

# ==== cluster UIZoomViewport
model = ClusterInput()
model_2 = Brep(model)

# ---- group: CREATE VIEWPORTS
create_button = CreateButton(ButtonName="Zoom", ButtonStyle=0)
value_listener = ValueListener(Elements=create_button, SomeProperty=True)  # -> Values, Indices
panel = Panel(value_listener.Values)
zoom_geometry = GhPythonScript(object=model_2, set=panel)
# ---------- zoom_geometry: Python ----------
__author__ = "kayla"
__version__ = "2023.02.13"

import rhinoscriptsyntax as rs
import scriptcontext as sc
import Rhino




if set:
    
    box = rs.BoundingBox(object)
    sc.doc = Rhino.RhinoDoc.ActiveDoc
    rs.ZoomBoundingBox(box)
    sc.doc = ghdoc
# ---------- end zoom_geometry ----------

# ----
ui_zoom_vp = Text(create_button)
ui_zoom_vp_2 = ClusterOutput(ui_zoom_vp)

# ==== cluster PulseImport
port = ClusterInput()
toggle = ClusterInput()
port_2 = Text(port)
toggle_2 = Text(toggle)

# ----
# Pulse
open_close_port = OpenClosePort(OpenClosePort=toggle_2, PortNumber=port_2, BaudRate=115200)
trigger = Trigger(Interval=2000, TimerInterval=2000, Target=serial_read_generic)  # disabled
serial_read_generic = SerialReadGeneric(StartReadingValues=toggle_2, PortNumber=port_2)  # -> SerialOutput, StatusMessage
data_dam = DataDam(DataDataA=serial_read_generic.SerialOutput, BufferDelay=20000000, BufferMode=1)
# LIVE PULSE
panel = Panel(data_dam)
create_label = CreateLabel(LabelText=panel, LabelSize=12, Justification=0)
text_split = TextSplit(Text=panel, Separators=" ")
panel_2 = Panel(text_split)
list_item = ListItem(List=panel_2, Index="4", Wrap=True)

ui_pulse_detected = Text(create_label)
pulse_value = Text(list_item)
pulse_value_2 = ClusterOutput(pulse_value)
ui_pulse_detected_2 = ClusterOutput(ui_pulse_detected)

# ==== cluster SeaLevelXYear
# SEA LEVEL BY YEAR CSV
csv = ClusterInput()
csv_2 = Text(csv)

# ---- group: CSV
ghpython_script = GhPythonScript(file_path=csv_2)  # -> points
# ---------- ghpython_script: Python ----------
__author__ = "ericsonm"
__version__ = "2023.01.30"

import csv
import rhinoscriptsyntax as rs


#source: https://developer.rhino3d.com/guides/rhinopython/python-csv-file/
#source: https://www.geeksforgeeks.org/reading-csv-files-in-python/


with open(file_path, mode = 'r') as file:
    
    csv_file = csv.reader(file)
    points = []
    for line in csv_file:

        try:
            x = float(line[0])
            y = float(line[1])
            point = rs.AddPoint(x,y,0)
            points.append(point)
            
        except:
            pass
# ---------- end ghpython_script ----------
deconstruct = Deconstruct(Point=ghpython_script)  # -> XComponent, YComponent, ZComponent

# ----
sea_level = Text(deconstruct.YComponent)
years = Text(deconstruct.XComponent)
years_2 = ClusterOutput(years)
sea_level_2 = ClusterOutput(sea_level)

# ==== cluster SeaLevelXPulse
pulse_live = ClusterInput()
scale_factor = ClusterInput()
reset = ClusterInput()
pulse_live_2 = Number(pulse_live)
scale_factor_2 = Number(scale_factor)
# HOW TO CONTROL A TIMER
reset_2 = Text(reset)
panel = Panel(pulse_live_2)
current_pulse = GhPythonScript(pulse=pulse_live_2)  # -> current_pulse; inputs pulse: list
# ---------- current_pulse: Python ----------
#kayla castro
#03/19/2023
#this component gives last pulse



current_pulse = pulse[-1]
# ---------- end current_pulse ----------
mood_change = GhPythonScript(pulse=panel)  # -> toggle; inputs pulse: list
# ---------- mood_change: Python ----------
#kayla castro
#03/07/2023
#this component reads pulse and returns:
#                                 nervous = true
#                                 calm = false
##################################################
########### with help from chatgpt & Mark


def pulse_difference(pulse_list):

    current_pulse = pulse_list[-1]
    previous_pulse = pulse_list[-2]
    
    pulse_a = current_pulse - previous_pulse
    pulse_b = previous_pulse - current_pulse
    
    print pulse_a
    print pulse_b
    
    
    if pulse_a > 5:
        return True
    else:
        return False

toggle = pulse_difference(pulse)
# ---------- end mood_change ----------
mood_update = GhPythonScript(pulse=panel)  # -> toggle; inputs pulse: list
# ---------- mood_update: Python ----------
#kayla castro
#03/07/2023
#this component reads pulse and returns:
#                                 nervous = true
#                                 calm = false
##################################################
########### with help from chatgpt & Mark


def pulse_difference(pulse_list):

    current_pulse = pulse_list[-1]
    previous_pulse = pulse_list[-2]
    
    pulse_a = current_pulse - previous_pulse
    pulse_b = previous_pulse - current_pulse
    
    print pulse_a
    print pulse_b
    
    
    if pulse_b > 5:
        return False
    else:
        return True

toggle = pulse_difference(pulse)
# ---------- end mood_update ----------
multiplication = Multiplication(A=pulse_live_2, B=scale_factor_2)
list_item = ListItem(List=multiplication, Index=0, Wrap=True)  # -> Item1, Item
panel_2 = Panel(mood_update)
current_pulse_2 = Text(current_pulse)
panel_3 = Panel(list_item.Item1)

panel_4 = Panel(mood_change)
invert_counter = InvertCounter(Start="20", Step=panel_3, Invert=panel_4, Pause=panel_2, Reset=reset_2)

current_pulse_3 = ClusterOutput(current_pulse_2)
count = Text(invert_counter)
count_2 = ClusterOutput(count)

# ==== cluster SeaLevelXColor
coastline = ClusterInput()
outline = ClusterInput()
lossy = ClusterInput()
outline_2 = Curve(outline)
box_rectangle = BoxRectangle(Rectangle=outline_2, Height=Domain(0, 10))
deconstruct_brep = DeconstructBrep(Brep=box_rectangle)  # -> Faces, Edges, Vertices
list_item = ListItem(List=deconstruct_brep.Faces, Index="4", Wrap=True)
lossy_2 = Number(lossy)
divide_domain² = DivideDomain²(Domain=list_item, UCount=lossy_2, VCount=lossy_2)
size = ClusterInput()
isotrim = Isotrim(Surface=list_item, Domain=divide_domain²)
coastline_2 = Curve(coastline)
area = Area(Geometry=isotrim)  # -> Area, Centroid
partition_list = PartitionList(List=isotrim, Size=size)
curve_closest_point = CurveClosestPoint(Point=area.Centroid, Curve=coastline_2)  # -> Point, Parameter, Distance
panel = Panel(partition_list)
flatten_tree = FlattenTree(Tree=curve_closest_point.Distance, Path="{0}")
bounds = Bounds(Numbers=curve_closest_point.Point)
bounds_2 = Bounds(Numbers=flatten_tree)
deconstruct_domain = DeconstructDomain(Domain=bounds)  # -> Start, End
remap_numbers = RemapNumbers(Value=curve_closest_point.Distance, Source=bounds_2, Target=bounds)  # -> Mapped, Clipped
panel_2 = Panel(remap_numbers.Mapped)
gradient = Gradient(
    LowerLimit=deconstruct_domain.Start,
    UpperLimit=deconstruct_domain.End,
    Parameter=remap_numbers.Mapped,
    stops=[0: RGB(255, 255, 255), 0.152: RGB(198, 136, 157), 0.645: RGB(158, 79, 111)])
chunks = ClusterOutput(partition_list)
decontructed_mesh = ClusterOutput(list_item)
colour = ClusterOutput(gradient)

# ==== cluster SeaLevelXPulseInv
scale_factor = ClusterInput()
pulse_live = ClusterInput()
reset = ClusterInput()
scale_factor_2 = Number(scale_factor)
# HOW TO CONTROL A TIMER
reset_2 = Text(reset)
pulse_live_2 = Number(pulse_live)
panel = Panel(pulse_live_2)
current_pulse = GhPythonScript(pulse=pulse_live_2)  # -> current_pulse; inputs pulse: list; same code as current_pulse
mood_update = GhPythonScript(pulse=panel)  # -> toggle; inputs pulse: list
# ---------- mood_update: Python ----------
#kayla castro
#03/07/2023
#this component reads pulse and returns:
#                                 nervous = true
#                                 calm = false
##################################################
########### with help from chatgpt & Mark


def pulse_difference(pulse_list):

    current_pulse = pulse_list[-1]
    previous_pulse = pulse_list[-2]
    
    pulse_a = current_pulse - previous_pulse
    pulse_b = previous_pulse - current_pulse
    
    print pulse_a
    print pulse_b
    
    
    if pulse_b > 6:
        return True
    else:
        return False

toggle = pulse_difference(pulse)
# ---------- end mood_update ----------
mood_change = GhPythonScript(pulse=panel)  # -> toggle; inputs pulse: list
# ---------- mood_change: Python ----------
#kayla castro
#03/07/2023
#this component reads pulse and returns:
#                                 nervous = true
#                                 calm = false
##################################################
########### with help from chatgpt & Mark


def pulse_difference(pulse_list):

    current_pulse = pulse_list[-1]
    previous_pulse = pulse_list[-2]
    
    pulse_a = current_pulse - previous_pulse
    pulse_b = previous_pulse - current_pulse
    
    print pulse_a
    print pulse_b
    
    
    if pulse_a > 6:
        return True
    else:
        return False

toggle = pulse_difference(pulse)
# ---------- end mood_change ----------
multiplication = Multiplication(A=pulse_live_2, B=scale_factor_2)
list_item = ListItem(List=multiplication, Index=0, Wrap=True)  # -> Item1, Item
panel_2 = Panel(mood_update)
ghpython_script = GhPythonScript()  # -> out, a
# ---------- ghpython_script: Python ----------
__author__ = "kayla"
__version__ = "2023.04.18"

import rhinoscriptsyntax as rs


if mood= True:
    pulse
# ---------- end ghpython_script ----------
current_pulse_2 = Text(current_pulse)
panel_3 = Panel(list_item.Item1)

panel_4 = Panel(mood_change)
invert_counter = InvertCounter(Start="20", Step=panel_3, Invert=panel_2, Pause=panel_4, Reset=reset_2)

current_pulse_3 = ClusterOutput(current_pulse_2)
count = Text(invert_counter)
count_2 = ClusterOutput(count)
