# Grasshopper definition Castro_SeaLevelX_example.gh (Grasshopper 1.0.7)
# plug-ins: Human UI

lossy = Slider(13, range=0..50)

# ----
# PULSE IMPORT
number_slider = Slider(3, range=0..4)
trigger = Trigger(Interval=1000, TimerInterval=1000, Target=pulse_import)  # disabled
pulse_import = PulseImport(toggle=Toggle(False), port=number_slider)  # -> ui_pulse_detected_2, pulse_value_2

curve = Curve(<curve referenced from the Rhino model>)
curve_2 = Curve(<curve referenced from the Rhino model>)
sea_level_x_color = SeaLevelXColor(outline=curve, coastline=curve_2, lossy=lossy)  # -> chunks, colour

trigger_2 = Trigger(Interval=1000, TimerInterval=1000, Target=heart_rate_list)  # disabled
heart_rate_list = GhPythonScript(reset=Toggle(False), pulse=pulse_import.pulse_value_2)  # -> status, heart_rate_list; inputs pulse: Int32
# ---------- heart_rate_list: Python ----------
"""Sticky list to collect the last two heartrates"""

from ghpythonlib.componentbase import executingcomponent as component
import Grasshopper, GhPython
import System
import Rhino
import rhinoscriptsyntax as rs
import scriptcontext as sc

__author__ = "ericsonm"
__version__ = "2023.04.17"

class MyComponent(component):
    
    def RunScript(self, reset, pulse):

        
        heart_rate = None
        
        value = int(pulse)
        if "value" not in sc.sticky or reset:
            sc.sticky["value"] = []
        if not reset:
            sc.sticky["value"].append(pulse)
            if len(sc.sticky["value"]) > 2:
                sc.sticky["value"].pop(0)
            heart_rate = sc.sticky["value"]
        
        
        # return outputs if you have them; here I try it for you:
        return heart_rate
# ---------- end heart_rate_list ----------
# PULSE TO COUNT
sea_level_x_pulse = SeaLevelXPulse(reset=Toggle(False), scale_factor=Slider(2, range=0..2), pulse_live=heart_rate_list.heart_rate_list)  # -> count_2, current_pulse_3

list_item = ListItem(List=sea_level_x_color.chunks, Index="1", Wrap=True)
list_item_2 = ListItem(List=sea_level_x_color.chunks, Index="2", Wrap=True)
list_item_3 = ListItem(List=sea_level_x_color.chunks, Index="3", Wrap=True)
sea_level_x_year = SeaLevelXYear(csv="D:\ARCH 441\Spring 2023\Sea Levelsx.csv")  # -> years_2, sea_level_2

box_rectangle = BoxRectangle(Rectangle=list_item, Height=sea_level_x_pulse.count_2)
box_rectangle_2 = BoxRectangle(Rectangle=[list_item_2, list_item_3], Height=Domain(0, 10))
# WAVE GENERATION
box = Box([box_rectangle, box_rectangle_2])
custom_preview = CustomPreview(Geometry=box, Material=sea_level_x_color.colour)

round = Round(Number=sea_level_x_pulse.current_pulse_3)  # -> Nearest, Floor, Ceiling

# ----
# YEAR COUNTER
progress_year = GhPythonScript(year=sea_level_x_year.years_2, counter=round.Nearest)  # -> current_year; inputs year: list, counter: Int32
# ---------- progress_year: Python ----------
#kayla castro
#04/18/23
#this component iterates through a list to get the year

#years are listed out in an attempt to get the code to run

import rhinoscriptsyntax as rs
import scriptcontext


def get_next_item(year, counter):
    try:
        index = year.index(counter)
        if index == len(year) - 1:
            return year[0]
        else:
            return year[index + 1]
    except ValueError:
        print("{} is not a valid index.".format(counter))

for i, value in enumerate(year):
    if i == counter:
        current_year = get_next_item(year, value)
        break
else:
    current_year = "{} is not a valid index.".format(counter)
# ---------- end progress_year ----------
panel = Panel(progress_year)

# ----
# SEA LEVEL  COUNTER
progress_slx = GhPythonScript(year=sea_level_x_year.sea_level_2, counter=round.Nearest)  # -> current_year; inputs year: list of Int32, counter: Int32
# ---------- progress_slx: Python ----------
"""this component iterates through a list of sea level heights or years to display on the interface"""

from ghpythonlib.componentbase import executingcomponent as component
import Grasshopper, GhPython
import System
import Rhino
import rhinoscriptsyntax as rs
import scriptcontext

#kayla castro
#04/18/23

class MyComponent(component):
    
    def RunScript(self, year, counter):
        
        current_year = None
        def get_next_item(year, counter):
            try:
                index = year.index(counter)
                if index == len(year) - 1:
                    return year[0]
                else:
                    return year[index + 1]
            except ValueError:
                print("{} is not a valid index.".format(counter))
        
        for i, value in enumerate(year):
            if i == counter:
                current_year = get_next_item(year, value)
                break
        else:
            current_year = "{} is not a valid index.".format(counter)
        
        
        # return outputs if you have them; here I try it for you:
        return current_year
# ---------- end progress_slx ----------
panel_2 = Panel(progress_slx)

create_label = CreateLabel(LabelText="Where the sea level is", LabelSize="15", Justification="3")
create_label_2 = CreateLabel(LabelText="feet above sea level", LabelSize="15", Justification="3")
create_label_3 = CreateLabel(LabelText="You are now entering the year", LabelSize="15", Justification="3")
create_label_4 = CreateLabel(LabelText=panel, LabelSize="20", Justification="1")
create_label_5 = CreateLabel(LabelText=panel_2, LabelSize="20", Justification="1")
create_label_6 = CreateLabel(LabelText="Pulse", LabelSize="15", Justification="3")
create_label_7 = CreateLabel(LabelText=pulse_import.pulse_value_2, LabelSize="20", Justification="1")
number_slider_2 = Slider(720, range=0..1000)
launch_window = LaunchWindow(
    Show=Toggle(False),
    Name="SeaLevelX",
    Width=number_slider_2,
    Height=number_slider_2,
    ChildStatus=2,
    EnableHorizScroll=False)
create_label_8 = CreateLabel(LabelText="Welcome to SeaLevel X", LabelSize="30", Justification="1")
boolean_toggle = BooleanToggle(False)
create_stack = CreateStack(UIElements=[create_label_3, create_label_4], Horizontal=boolean_toggle)  # -> flatten(Stack)
create_stack_2 = CreateStack(UIElements=[create_label, create_label_5], Horizontal=boolean_toggle)  # -> flatten(Stack)
add_elements = AddElements(
    Window=launch_window,
    Elements=flatten([create_label_8, create_stack, create_stack_2, create_label_2, create_label_6, create_label_7]),
    DoVLChecking=True)  # -> AddedElements, ElementNames
panel_3 = Panel(add_elements.ElementNames)

# ==== cluster PulseImport
port = ClusterInput()
toggle = ClusterInput()
port_2 = Text(port)
toggle_2 = Text(toggle)

# ----
# Pulse
open_close_port = OpenClosePort(OpenClosePort=toggle_2, PortNumber=port_2, BaudRate=115200)
trigger = Trigger(Interval=1000, TimerInterval=1000, Target=serial_read_generic)
serial_read_generic = SerialReadGeneric(StartReadingValues=toggle_2, PortNumber=port_2)  # -> SerialOutput, StatusMessage
data_dam = DataDam(DataDataA=serial_read_generic.SerialOutput, BufferDelay=20000000, BufferMode=1)
# LIVE PULSE
panel = Panel(data_dam)
create_label = CreateLabel(LabelText=panel, LabelSize=12, Justification=0)
text_split = TextSplit(Text=panel, Separators=" ")
panel_2 = Panel(text_split)
list_item = ListItem(List=panel_2, Index="4", Wrap=True)

panel_3 = Panel(open_close_port)
ui_pulse_detected = Text(create_label)
pulse_value = Text(list_item)
pulse_value_2 = ClusterOutput(pulse_value)
ui_pulse_detected_2 = ClusterOutput(ui_pulse_detected)
panel_4 = Panel(pulse_value)

# ==== cluster SeaLevelXYear
# SEA LEVEL BY YEAR CSV
csv = ClusterInput()
csv_2 = Text(csv)

# ---- group: CSV
ghpython_script = GhPythonScript(file_path=csv_2)  # -> points
# ---------- ghpython_script: Python ----------
__author__ = "ericsonm"
__version__ = "2023.01.30"

import csv
import rhinoscriptsyntax as rs


#source: https://developer.rhino3d.com/guides/rhinopython/python-csv-file/
#source: https://www.geeksforgeeks.org/reading-csv-files-in-python/


with open(file_path, mode = 'r') as file:
    
    csv_file = csv.reader(file)
    points = []
    for line in csv_file:

        try:
            x = float(line[0])
            y = float(line[1])
            point = rs.AddPoint(x,y,0)
            points.append(point)
            
        except:
            pass
# ---------- end ghpython_script ----------
deconstruct = Deconstruct(Point=ghpython_script)  # -> XComponent, YComponent, ZComponent

# ----
sea_level = Text(deconstruct.YComponent)
years = Text(deconstruct.XComponent)
years_2 = ClusterOutput(years)
sea_level_2 = ClusterOutput(sea_level)

# ==== cluster SeaLevelXColor
coastline = ClusterInput()
outline = ClusterInput()
lossy = ClusterInput()
outline_2 = Curve(outline)
box_rectangle = BoxRectangle(Rectangle=outline_2, Height=Domain(0, 10))
deconstruct_brep = DeconstructBrep(Brep=box_rectangle)  # -> Faces, Edges, Vertices
list_item = ListItem(List=deconstruct_brep.Faces, Index="4", Wrap=True)
lossy_2 = Number(lossy)
divide_domain² = DivideDomain²(Domain=list_item, UCount=lossy_2, VCount=lossy_2)
isotrim = Isotrim(Surface=list_item, Domain=divide_domain²)
coastline_2 = Curve(coastline)
area = Area(Geometry=isotrim)  # -> Area, Centroid
partition_list = PartitionList(List=isotrim, Size="3")
curve_closest_point = CurveClosestPoint(Point=area.Centroid, Curve=coastline_2)  # -> Point, Parameter, Distance
panel = Panel(partition_list)
flatten_tree = FlattenTree(Tree=curve_closest_point.Distance, Path="{0}")
bounds = Bounds(Numbers=curve_closest_point.Point)
bounds_2 = Bounds(Numbers=flatten_tree)
deconstruct_domain = DeconstructDomain(Domain=bounds)  # -> Start, End
remap_numbers = RemapNumbers(Value=curve_closest_point.Distance, Source=bounds_2, Target=bounds)  # -> Mapped, Clipped
panel_2 = Panel(remap_numbers.Mapped)
gradient = Gradient(
    LowerLimit=deconstruct_domain.Start,
    UpperLimit=deconstruct_domain.End,
    Parameter=remap_numbers.Mapped,
    stops=[0: RGB(255, 255, 255), 0.152: RGB(198, 136, 157), 0.645: RGB(158, 79, 111)])
chunks = ClusterOutput(partition_list)
colour = ClusterOutput(gradient)

# ==== cluster SeaLevelXPulse
scale_factor = ClusterInput()
pulse_live = ClusterInput()
reset = ClusterInput()
scale_factor_2 = Number(scale_factor)
# HOW TO CONTROL A TIMER
reset_2 = Text(reset)
pulse_live_2 = Number(pulse_live)
panel = Panel(pulse_live_2)
current_pulse = GhPythonScript(pulse=pulse_live_2)  # -> current_pulse; inputs pulse: list
# ---------- current_pulse: Python ----------
#kayla castro
#03/19/2023
#this component gives last pulse



current_pulse = pulse[-1]
# ---------- end current_pulse ----------
mood_update = GhPythonScript(pulse=panel)  # -> toggle; inputs pulse: list
# ---------- mood_update: Python ----------
#kayla castro
#03/07/2023
#this component reads pulse and returns:
#                                 nervous = true
#                                 calm = false
##################################################
########### with help from chatgpt & Mark


def pulse_difference(pulse_list):

    current_pulse = pulse_list[-1]
    previous_pulse = pulse_list[-2]
    
    pulse_a = current_pulse - previous_pulse
    pulse_b = previous_pulse - current_pulse
    
    print pulse_a
    print pulse_b
    
    
    if pulse_b > 6:
        return True
    else:
        return False

toggle = pulse_difference(pulse)
# ---------- end mood_update ----------
mood_change = GhPythonScript(pulse=panel)  # -> toggle; inputs pulse: list
# ---------- mood_change: Python ----------
#kayla castro
#03/07/2023
#this component reads pulse and returns:
#                                 nervous = true
#                                 calm = false
##################################################
########### with help from chatgpt & Mark


def pulse_difference(pulse_list):

    current_pulse = pulse_list[-1]
    previous_pulse = pulse_list[-2]
    
    pulse_a = current_pulse - previous_pulse
    pulse_b = previous_pulse - current_pulse
    
    print pulse_a
    print pulse_b
    
    
    if pulse_a > 6:
        return True
    else:
        return False

toggle = pulse_difference(pulse)
# ---------- end mood_change ----------
multiplication = Multiplication(A=pulse_live_2, B=scale_factor_2)
list_item = ListItem(List=multiplication, Index=0, Wrap=True)  # -> Item1, Item
panel_2 = Panel(mood_update)
current_pulse_2 = Text(current_pulse)
panel_3 = Panel(list_item.Item1)

panel_4 = Panel(mood_change)
invert_counter = InvertCounter(Start="400", Step=panel_3, Invert=panel_2, Pause=panel_4, Reset=reset_2)

current_pulse_3 = ClusterOutput(current_pulse_2)
count = Text(invert_counter)
count_2 = ClusterOutput(count)
